# Dynamo custom node Arrowhead Assigner.dyf (Dynamo 0.9.0.3067)
# category: Rhythm.Tools
# This node assings the arrowhead type for all text and keynote tags. There is an input for ones you want to exclude.

element_types = ElementTypes("TextNoteType")
all_elements_of_type = ElementsOfType(element_types)
convertTextNotes = Input(convertTextNotes : bool=false)

# group: Text Notes
toggle = Custom[Rhythm.Toggle](list=all_elements_of_type, boolean=convertTextNotes)  # Toggle that offers two outputs. Created for Dynamo 0.8.1 because of changes to the "IF" node

# group: Gets the family types for the tags (unplaced)
element_types_2 = ElementTypes("FamilySymbol")
all_elements_of_type_2 = ElementsOfType(element_types_2)
category = Custom[Element.Category](element=all_elements_of_type_2)  # This node will get the input element(s)' categories
groupByKey = GroupByKey(all_elements_of_type_2, category)
code_block = CodeBlock(t1=groupByKey.out1, t2=groupByKey.out0)
# ---------- code_block.designscript (10 lines) ----------
t3 = IndexOf(t1, "Keynote Tags");
t4 = IndexOf(t1, "Room Tags");
t5 = IndexOf(t1, "Door Tags");
t6 = IndexOf(t1, "Window Tags");
t7 = IndexOf(t1, "Wall Tags");
t2[t3];
t2[t4];
t2[t5];
t2[t6];
t2[t7];
# ----------------------------------------

convertKeynoteTags = Input(convertKeynoteTags : bool=false)

# group: Keynote Tags
toggle_2 = Custom[Rhythm.Toggle](list=code_block.out5, boolean=convertKeynoteTags)

convertRoomTags = Input(convertRoomTags : bool=false)

# group: Room Tags
toggle_3 = Custom[Rhythm.Toggle](list=code_block.out6, boolean=convertRoomTags)

convertDoorTags = Input(convertDoorTags : bool=false)

# group: Door Tags
toggle_4 = Custom[Rhythm.Toggle](list=code_block.out7, boolean=convertDoorTags)

convertWindowTags = Input(convertWindowTags : bool=false)

# group: Window Tags
toggle_5 = Custom[Rhythm.Toggle](list=code_block.out8, boolean=convertWindowTags)

convertWallTags = Input(convertWallTags : bool=false)

# group: Wall Tags
toggle_6 = Custom[Rhythm.Toggle](list=code_block.out9, boolean=convertWallTags)

code_block_2 = CodeBlock(a=toggle.in, b=toggle_2.in, c=toggle_3.in, d=toggle_4.in, e=toggle_5.in, f=toggle_6.in) { Flatten({a,b,c,d,e,f}); }
RunMe = Input(RunMe : bool=false)

# group: RunMe
toggle_7 = Custom[Rhythm.Toggle](list=code_block_2, boolean=RunMe)

string = StringInput("Leader Arrowhead")
arrowheadType = Input(arrowheadType : string)

# group: Gets the arrowhead type
element_types_3 = ElementTypes("ElementType")
all_elements_of_type_3 = ElementsOfType(element_types_3)
name = Element.Name(all_elements_of_type_3)
indexOf = IndexOf(name, arrowheadType)
getItemAtIndex = List.GetItemAtIndex(list=all_elements_of_type_3, index=indexOf)

setParameterByName = Element.SetParameterByName(element=toggle_7.in, parameterName=string, value=getItemAtIndex)
Element = Output(setParameterByName)
