# Dynamo custom node Rhythm.3DRoomTags.dyf (Dynamo 1.3.2.2480)
# category: Rhythm.Tools
# This node will generate 3D room tags for all rooms in the model. (RFA in extra folder in Dynamo download)

ThreeDRoomTag = Input(ThreeDRoomTag : FamilyType)
RunMe = Input(RunMe : bool=false)
python_script = Python(IN[0]=RunMe)
# ---------- python_script.python (41 lines) ----------
#Copyright(c) 2017, john pierson
# @60secondrevit, http://sixtysecondrevit.com

import clr
clr.AddReference('ProtoGeometry')
from Autodesk.DesignScript.Geometry import *

# Import DocumentManager and TransactionManager
clr.AddReference("RevitServices")
import RevitServices
from RevitServices.Persistence import DocumentManager
from RevitServices.Transactions import TransactionManager

# Import RevitAPI
clr.AddReference("RevitAPI")
import Autodesk
from Autodesk.Revit.DB import *
clr.AddReference("RevitNodes")


doc = DocumentManager.Instance.CurrentDBDocument
uiapp = DocumentManager.Instance.CurrentUIApplication
app = uiapp.Application

from System.Collections.Generic import *


#The inputs to this node will be stored as a list in the IN variable.
dataEnteringNode = IN
phase = UnwrapElement(IN[0])
collector = FilteredElementCollector(doc)
rooms = collector.OfCategory(BuiltInCategory.OST_Rooms).ToElements()

roomInstances = []
if IN[0] == True:
	for i in rooms:
			if i.Area != 0:
				roomInstances.append(i)
else:
	roomInstances.append("set run me to true")
OUT = roomInstances
# ----------------------------------------

# group: Room locations and parameters.
location = Room.Location(python_script)
number = Room.Number(python_script)

code_block = CodeBlock { "Name"; }
getParameterValueByName = Element.GetParameterValueByName(element=python_script, parameterName=code_block)

# group: Creates tag and sets parameters.
byPoint = FamilyInstance.ByPoint(familyType=ThreeDRoomTag, point=location)
code_block_2 = CodeBlock { "Name"; "Number"; }
setParameterByName = Element.SetParameterByName(element=byPoint, parameterName=code_block_2.out1, value=number)
setParameterByName_2 = Element.SetParameterByName(element=setParameterByName, parameterName=code_block_2.out0, value=getParameterValueByName)

clean = Custom[Output.Clean](input=setParameterByName_2)  # This will return a single value or list from one input.
ThreeDRoomTags = Output(clean)
