# Dynamo custom node Select Elements By Curve.dyf (Dynamo 1.2.1.3083)
# category: Rhythm.Revit.Selection.Actions
# This will select model elements in order that a curve is drawn through them.

modelCurve = Input()

# group: divide up model curve through elements
curve = CurveElement.Curve(modelCurve)

code_block = CodeBlock { 0..1..#400; }
pointAtParameter = Curve.PointAtParameter(curve=curve, param=code_block)
splitByPoints = Curve.SplitByPoints(curve=curve, points=pointAtParameter)

# group (continued): divide up model curve through elements
endPoint = Curve.EndPoint(splitByPoints)

flatten = Flatten(endPoint)
category = Input()
all_elements_of_category = ElementsOfCategory(category)
RunMe = Input(RunMe : bool)
toggle = Custom[Rhythm.Toggle](list=all_elements_of_category, boolean=RunMe)  # Toggle that offers two outputs. Created for Dynamo 0.8.1 because of changes to the "IF" node

# group: this area enables the graph to work with model elements
boundingBox = Element.BoundingBox(toggle.in)

contains = BoundingBox.Contains(boundingBox)  # unwired: arg1
map = List.Map(list=flatten, f_x=contains)
filterByBoolMask = List.FilterByBoolMask(list=toggle.in)  # unwired: mask
map_2 = List.Map(list=map, f_x=filterByBoolMask.in)
flatten_2 = Flatten(map_2)
uniqueItems = List.UniqueItems(flatten_2)
Items = Output(uniqueItems)
